# Grasshopper definition example.gh (Grasshopper 1.0.7)
# plug-ins: baues-toolbox Info, THERB-GH

brep = Brep([<brep referenced from the Rhino model> x12])
srf = Surface(<surface referenced from the Rhino model>)
brep_2 = Brep([<brep referenced from the Rhino model> x20])
srf_2 = Surface([<surface referenced from the Rhino model> x3])

brep_3 = Brep([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])
srf_3 = Surface([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])

therb = THERB(Boxes=brep, Windows=srf, Tolerance=0.1)  # -> Therb, Test

number_slider = Slider(0.1, range=0..0.1)
windows_split = Surface([<surface referenced from the Rhino model> x3])
# step1. ジオメトリ、条件入力
rooms_split = Brep([<brep referenced from the Rhino model> x20])

number_slider_2 = Slider(0, range=0..3)
# 北の方角を指定
vec = Vector()
# タスク13.fiterFaceByPropertyを実装
decompose = Decompose(Therb=therb.Therb)  # -> Rooms, Faces, Windows, Overhangs
brep_4 = Brep([<brep referenced from the Rhino model> x3])
panel = Panel("exterior")
brep_5 = Brep([<brep referenced from the Rhino model> x2])
brep_6 = Brep([<brep referenced from the Rhino model> x3])
brep_7 = Brep([<brep referenced from the Rhino model> x2])
filterfacebyproperty = FilterFaceByProperty(Faces=decompose.Faces, Bc=1, SurfT=-1, Direction=-1)  # -> TrueFace, FalseFace
srf_4 = Surface(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)
srf_5 = Surface(<surface referenced from the Rhino model>)
srf_6 = Surface(<surface referenced from the Rhino model>)
therb_2 = THERB(Geometries=brep_6, Tolerance=Slider(0.1, range=0.1..10))  # -> Therb, Test
python = GhPythonScript(x=srf_4, y=Slider(0.61, range=0..1), z=Slider(0.25, range=0..1))  # -> out, a, b; inputs x: Surface
# ---------- python: Python ----------
u = x.Domain(0).ParameterAt(y)
v = x.Domain(1).ParameterAt(z)

a = x.PointAt(u, v)

b = x.Split(0, u)
# ---------- end python ----------
readproperty = ReadProperty(Faces=filterfacebyproperty.TrueFace)  # -> PartId, Surface, ElementType, Normal, Direction, AdjacencyRoomId
readproperty_2 = ReadProperty()
updateconstruction = UpdateConstruction(Face=filterfacebyproperty.TrueFace)
srf_7 = Surface(python.b)
item = CherryPicker(therb_2.Test, ListIndex=0)
digit_scroller = DigitScroller(Scroller_Digits=12, Scroller_Prefix="Index", Scroller_Radix=11, Scroller_Value=13)
python_2 = GhPythonScript(x=brep_7, y=srf_6)  # -> out, a; inputs x: list
# ---------- python_2: Python ----------
a = [x, y]
# ---------- end python_2 ----------
srf_8 = Surface(readproperty.Surface)
exportb = ExportB(Therb=therb.Therb)
exportr = ExportR(Therb=therb.Therb)
run_simulation = RunSimulation(Therb=therb.Therb, Name="TEST", Run=Toggle(False))
item_2 = ListItem(Index=digit_scroller, Wrap=True)

# ----
# step2. 出力をチェック
b_datファイル書き出し = Panel(exportb)
r_datファイル書き出し = Panel(exportr)

# ----
# step03.
# サーバーにuploadする
# ための情報を入力
# step03-1. サーバーのドメイン入力
# (今のところ、ここは変える必要ないです）
# step03-2. プロジェクト名を入力
# step03-3. Trueにするとuploadして計算開始
panel_2 = Panel("http://localhost:5000/run")

uploadtherb = UploadTherb(Url=panel_2, ProjectName="demo2", Upload=Toggle(True))
# step04.
# サーバーからのresponseが表示されます。
# successとなっていれば、以下のurlをchrome
# で表示してください
# step05.
# 計算結果をPythonを利用してさらに分析することができます。
# 以下に分析例をまとめたJupyter Notebookを置いています。
# https://github.com/becat-oss/therb-notebook
panel_3 = Panel(uploadtherb)
